# Grasshopper definition 11.gh (Grasshopper 1.0.7)

xz_plane = XZPlane(Origin=Point(0, 0, 0))
rectangle = Rectangle(Plane=xz_plane, XSize=Slider(20, range=0..100), YSize=Slider(20, range=0..100), Radius=0)  # -> Rectangle, Length
explode = Explode(Curve=rectangle.Rectangle, Recursive=True)  # -> Segments, Vertices
list_item = ListItem(List=explode.Segments, Index=Slider(2, range=0..10), Wrap=True)
divide_curve = DivideCurve(Curve=list_item, Count=Slider(11, range=0..100), Kinks=False)  # -> Points, Tangents, Parameters
project = Project(Geometry=divide_curve.Points, Plane=PlaneXY(0, 0, 0))  # -> Geometry, Transform
line = Line(StartPoint=divide_curve.Points, EndPoint=project.Geometry)
divide_curve_2 = DivideCurve(Curve=line, Count=Slider(11, range=0..100), Kinks=False)  # -> Points, Tangents, Parameters
