# Grasshopper definition 12.gh (Grasshopper 1.0.7)
# plug-ins: Pufferfish

height = GetInteger(Slider(11, range=1..50), AtLeast=1, AtMost=1, Maximum=2147483647, Minimum=-2147483648, TreeAccess=False)
width = GetInteger(Slider(18, range=1..50), AtLeast=1, AtMost=1, Maximum=2147483647, Minimum=-2147483648, TreeAccess=False)
xz_plane = XZPlane(Origin=Point(0, 0, 0))
rectangle = Rectangle(Plane=xz_plane, XSize=width, YSize=height, Radius=0)  # -> Rectangle, Length
explode = Explode(Curve=rectangle.Rectangle, Recursive=True)  # -> Segments, Vertices
list_item = ListItem(List=explode.Segments, Index=Slider(0, range=0..10), Wrap=True)
list_item_2 = ListItem(List=explode.Segments, Index=Slider(2, range=0..10), Wrap=True)
list_item_3 = ListItem(List=explode.Segments, Index=Slider(1, range=0..10), Wrap=True)
get_geometry = GetGeometry(list_item, AtLeast=1, AtMost=1, DeleteInput=False, Filter=1074004029, TreeAccess=False)
point_on_curve = PointOnCurve(list_item_3, parameter=0.319)
point_on_curve_2 = PointOnCurve(list_item_3, parameter=0.098)
point_on_curve_3 = PointOnCurve(list_item_3, parameter=0.601)
point_on_curve_4 = PointOnCurve(get_geometry, parameter=0.323)
point_on_curve_5 = PointOnCurve(get_geometry, parameter=0.102)
point_on_curve_6 = PointOnCurve(list_item_3, parameter=0.858)
point_on_curve_7 = PointOnCurve(get_geometry, parameter=0.601)
point_on_curve_8 = PointOnCurve(get_geometry, parameter=0.858)
end_points = EndPoints(Curve=get_geometry)  # -> Start, End
negative = Negative(Value=Slider(0.43, range=0..10))
mullions = GetPoint(
    [point_on_curve_5, point_on_curve_4, point_on_curve_7, point_on_curve_8],
    AtLeast=1,
    AtMost=1,
    Realtime=True,
    TreeAccess=False)
transoms = GetPoint(
    [point_on_curve_2, point_on_curve, point_on_curve_3, point_on_curve_6],
    AtLeast=1,
    AtMost=1,
    Realtime=True,
    TreeAccess=False)
end_points_2 = EndPoints(Curve=list_item_3)  # -> Start, End
unit_y = UnitY(Factor=negative)
length = Length(Curve=list_item_3)
move = Move(Geometry=[transoms, end_points_2.Start, end_points_2.End], Motion=unit_y)  # -> Geometry, Transform
point = Point(Point(0, 0, 0))
yz_plane = YZPlane(Origin=mullions)
xy_plane = XYPlane(Origin=point)
horizontal_frame = HorizontalFrame(Curve=get_geometry, Parameter=[mullions, end_points.Start, end_points.End])
point_2 = Point([mullions, end_points.Start, end_points.End])
yz_plane_2 = YZPlane(Origin=move.Geometry)
project = Project(Geometry=graft(move.Geometry), Plane=yz_plane)  # -> Geometry, Transform
curve = Curve([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])
curve_2 = Curve([<curve referenced from the Rhino model> x2])
boundary_surfaces = BoundarySurfaces(Edges=curve_2)
rotate = Rotate(Geometry=yz_plane_2, Angle=degrees(Slider(90, range=0..100)), Plane=yz_plane_2)  # -> Geometry, Transform
boundary_surfaces_2 = BoundarySurfaces(Edges=curve)
orient = Orient(Geometry=graft(boundary_surfaces), Source=xy_plane, Target=rotate.Geometry)  # -> Geometry, Transform
orient_2 = Orient(Geometry=graft(boundary_surfaces_2), Source=xy_plane, Target=horizontal_frame)  # -> Geometry, Transform
length_2 = Length(Curve=list_item_2)
offset_mesh = OffsetMesh(Mesh=orient_2.Geometry, Distance=length, BothSides=0, CreateSolid=True)
unit_y_2 = UnitY(Factor=Slider(0.1, range=0..0.1))
offset_mesh_2 = OffsetMesh(Mesh=orient.Geometry, Distance=expr("x*-1", length_2), BothSides=0, CreateSolid=True)
boundary_surfaces_3 = BoundarySurfaces(Edges=rectangle.Rectangle)
bounding_box = BoundingBox(Content=offset_mesh, Plane=PlaneXY(0, 0, 0))  # -> Box, Box_2
negative_2 = Negative(Value=unit_y_2)
bounding_box_2 = BoundingBox(Content=offset_mesh_2, Plane=PlaneXY(0, 0, 0))  # -> Box, Box_2
move_2 = Move(Geometry=boundary_surfaces_3, Motion=negative_2)  # -> Geometry, Transform
solid_union = SolidUnion(Breps=flatten([bounding_box.Box, bounding_box_2.Box]))
brep_brep = BrepBrep(BrepA=move_2.Geometry, BrepB=solid_union)  # -> Curves, Points
boundary_surfaces_4 = BoundarySurfaces(Edges=brep_brep.Curves)
number_slider = Slider(0.32, range=0..1)
offset_mesh_3 = OffsetMesh(Mesh=boundary_surfaces_4, Distance=Slider(0.06, range=0..0.1), BothSides=0, CreateSolid=True)
context_bake = ContextBake(Geometry=[offset_mesh_3, solid_union])
