# Grasshopper definition assignment 01.1.gh (Grasshopper 1.0.7)
# plug-ins: Pufferfish

number_slider = Slider(0.13, range=0..1)
number_slider_2 = Slider(1.3, range=0..10)
segments = GetInteger(Slider(32, range=0..100), AtLeast=1, AtMost=1, Maximum=2147483647, Minimum=-2147483648, TreeAccess=False)
radius_02 = GetNumber(Slider(13.06, range=0..100), AtLeast=1, AtMost=1, Maximum=1.797693135e+308, Minimum=-1.797693135e+308, TreeAccess=False)
radius_01 = GetNumber(Slider(14, range=0..100), AtLeast=1, AtMost=1, Maximum=1.797693135e+308, Minimum=-1.797693135e+308, TreeAccess=False)
radius_05 = GetNumber(Slider(4.87, range=0..10), AtLeast=1, AtMost=1, Maximum=1.797693135e+308, Minimum=-1.797693135e+308, TreeAccess=False)
radius_04 = GetNumber(Slider(7.73, range=0..10), AtLeast=1, AtMost=1, Maximum=1.797693135e+308, Minimum=-1.797693135e+308, TreeAccess=False)
radius_03 = GetNumber(Slider(10.9, range=0..100), AtLeast=1, AtMost=1, Maximum=1.797693135e+308, Minimum=-1.797693135e+308, TreeAccess=False)
radius_06 = GetNumber(Slider(1.2, range=0..10), AtLeast=1, AtMost=1, Maximum=1.797693135e+308, Minimum=-1.797693135e+308, TreeAccess=False)
Z = UnitZ(Factor=Slider(11.3, range=0..100))
Z_2 = UnitZ(Factor=Slider(9.45, range=0..10))
Z_3 = UnitZ(Factor=Slider(10.61, range=0..100))
Z_4 = UnitZ(Factor=Slider(7.11, range=0..10))
Z_5 = UnitZ(Factor=Slider(3.83, range=0..10))
polygon = Polygon(Plane=Z, Radius=radius_06, Segments=segments, FilletRadius=0)  # -> Polygon, Length
polygon_2 = Polygon(Plane=PlaneXY(0, 0, 0), Radius=radius_01, Segments=segments, FilletRadius=0)  # -> Polygon, Length
polygon_3 = Polygon(Plane=Z_5, Radius=radius_02, Segments=segments, FilletRadius=0)  # -> Polygon, Length
polygon_4 = Polygon(Plane=Z_4, Radius=radius_03, Segments=segments, FilletRadius=0)  # -> Polygon, Length
polygon_5 = Polygon(Plane=Z_2, Radius=radius_04, Segments=segments, FilletRadius=0)  # -> Polygon, Length
polygon_6 = Polygon(Plane=Z_3, Radius=radius_05, Segments=segments, FilletRadius=0)  # -> Polygon, Length
pt = Point(Z)
divide = DivideCurve(Curve=polygon.Polygon, Count=segments, Kinks=False)  # -> Points, Tangents, Parameters
divide_2 = DivideCurve(Curve=polygon_3.Polygon, Count=segments, Kinks=False)  # -> Points, Tangents, Parameters
divide_3 = DivideCurve(Curve=polygon_4.Polygon, Count=segments, Kinks=False)  # -> Points, Tangents, Parameters
divide_4 = DivideCurve(Curve=polygon_5.Polygon, Count=segments, Kinks=False)  # -> Points, Tangents, Parameters
divide_5 = DivideCurve(Curve=polygon_6.Polygon, Count=segments, Kinks=False)  # -> Points, Tangents, Parameters
divide_6 = DivideCurve(Curve=polygon_2.Polygon, Count=segments, Kinks=False)  # -> Points, Tangents, Parameters
pcen = PolygonCenter(Polyline=polygon.Polygon)  # -> CenterV, CenterE, CenterA
ln = Line(StartPoint=divide_4.Points, EndPoint=divide_5.Points)
debrep = DeconstructBrep(Brep=polygon_2.Polygon)  # -> Faces, Edges, Vertices
ln_2 = Line(StartPoint=divide_6.Points, EndPoint=divide_2.Points)
ln_3 = Line(StartPoint=divide_2.Points, EndPoint=divide_3.Points)
ln_4 = Line(StartPoint=divide_5.Points, EndPoint=divide.Points)
ln_5 = Line(StartPoint=divide_4.Points, EndPoint=divide_3.Points)
ln_6 = Line(StartPoint=divide.Points, EndPoint=pcen.CenterV)
join = JoinCurves(Curves=[ln_2, ln_3, ln_5, ln, ln_4], Preserve=False)
parameter_pipe_mesh = ParameterPipeMesh(
    Curve=[polygon_4.Polygon, polygon_3.Polygon, polygon_2.Polygon, polygon_5.Polygon, polygon_6.Polygon, polygon.Polygon],
    Radius=Slider(0.13, range=0..1),
    ParametersU=[0, 0.1, 0.2, 0.3, 0.4, 0.5, 0.6, 0.7, 0.8, 0.9, 1],
    ParametersV=[0, 0.25, 0.5, 0.75, 1],
    Weighted=False,
    Lengths=False,
    Angle=Slider(1.25, range=0..10),
    Rotation=0,
    EndType=0,
    Triangulate=False)
context_bake = ContextBake(Profiles02=parameter_pipe_mesh)
number_slider_3 = Slider(33, range=0..100)
loft_opt = LoftOptions(Closed=Slider(1, range=0..1), Adjust=False, Rebuild=0, Refit=0, Type=Slider(3, range=0..10))

loft = Loft(Curves=join, Options=loft_opt)
debrep_2 = DeconstructBrep(Brep=loft)  # -> Faces, Edges, Vertices
neg = Negative(Value=Slider(0.06, range=0..0.1))
crv = Curve(debrep_2.Faces)
boundary = BoundarySurfaces(Edges=[crv, polygon.Polygon])
vec = VectorXYZ(XComponent=neg, YComponent=neg, ZComponent=neg)  # -> Vector, Length
pt_2 = Point(Point(1, 1, 1))
moveaway = MoveAwayFrom(Geometry=boundary, Emitter=pt_2, Distance=vec.Vector)  # -> Geometry, Transform

neg_2 = Negative(Value=Slider(0.24, range=0..1))
rectangle = Rectangle(Plane=debrep.Faces, XSize=Slider(0.14, range=0..1), YSize=neg_2, Radius=0)  # -> Rectangle, Length
arrpolar = PolarArray(Geometry=rectangle.Rectangle, Plane=PlaneXY(0, 0, 0), Count=segments, Angle=6.283185307)  # -> Geometry, Transform
pcen_2 = PolygonCenter(Polyline=arrpolar.Geometry)  # -> CenterV, CenterE, CenterA
graft = GraftTree(Tree=join, IncludeEmptyLists=True, IncludeNullItems=True)
neg_3 = Negative(Value=Slider(0.008, range=0..1))
rot3d = Rotate3D(Geometry=arrpolar.Geometry, Angle=Slider(3.08, range=0..10), Center=pcen_2.CenterV, Axis=Vector(0, 0, 1))  # -> Geometry, Transform
rot3d_2 = Rotate3D(Geometry=rot3d.Geometry, Angle=neg_3, Center=Point(0, 0, 0), Axis=Vector(0, 0, 1))  # -> Geometry, Transform
graft_2 = GraftTree(Tree=rot3d_2.Geometry, IncludeEmptyLists=True, IncludeNullItems=True)
swp1 = Sweep1(Rail=graft, Sections=graft_2, Miter=1)

debrep_3 = DeconstructBrep(Brep=boundary)  # -> Faces, Edges, Vertices
debrep_4 = DeconstructBrep(Brep=moveaway.Geometry)  # -> Faces, Edges, Vertices
graft_3 = GraftTree(Tree=debrep_3.Edges, IncludeEmptyLists=True, IncludeNullItems=True)
graft_4 = GraftTree(Tree=debrep_4.Edges, IncludeEmptyLists=True, IncludeNullItems=True)
parameter_pipe_mesh_2 = ParameterPipeMesh(
    Curve=graft,
    Radius=Slider(0.1, range=0..1),
    ParametersU=[0, 0.1, 0.2, 0.3, 0.4, 0.5, 0.6, 0.7, 0.8, 0.9, 1],
    ParametersV=[0, 0.25, 0.5, 0.75, 1],
    Weighted=False,
    Lengths=False,
    Angle=Slider(0.17, range=0..10),
    Rotation=Slider(32.57, range=0..60),
    EndType=0,
    Triangulate=False)
boundary_surfaces = BoundarySurfaces(Edges=flatten(graft_4))
cap = CapHoles(Brep=swp1)
context_bake_2 = ContextBake(Geometry=boundary_surfaces)
context_bake_3 = ContextBake(Profile01=cap)
